# Dynamo custom node MeshToFace.dyf "MeshByFace" (Dynamo 2.0.2.6826)
# category: HackStreetBoys
# Directly from the Dynamo Hackaton the Mesh By Face by the Hackstreet Boys!

# note: ORGANIZE FACE RECOGNITION POINTS
# note: ADJUST MESH POSITION
# note: MESH REDUCE
# note: TRIANGLE CENTER POINT
# note: uv points general surface
# note: GET GRID POINTS

mesh = Input(mesh: string)
importFile = Autodesk.Dynamo.MeshToolkit.Mesh.ImportFile(fileName=mesh)
XZ = Plane.XZ()
mirror = Autodesk.Dynamo.MeshToolkit.Mesh.Mirror(mesh=importFile, mirrorPlane=XZ)
path = Input(path: var[]..[])
file_from_path = FileObject(path=path)
readText = FileSystem.ReadText(file=file_from_path)
string = StringInput("{\n")
split = String.Split(str=readText, separater0=string)
length = String.Length(str=split)
code_block = CodeBlock(count=length) { count-1; 1; }
remove = String.Remove(str=split, startIndex=code_block.out0, count=code_block.out1)
code_block_2 = CodeBlock(p=remove) { p[1]; }
string_2 = StringInput("\n")
split_2 = String.Split(str=code_block_2, separater0=string_2)
code_block_3 = CodeBlock { " "; }
split_3 = String.Split(str=split_2@L2, separater0=code_block_3)
code_block_4 = CodeBlock(t2=split_3) { t3 = List.GetItemAtIndex(t2@L2<1>, 0); }
toNumber = String.ToNumber(str=code_block_4)
code_block_5 = CodeBlock(t2=split_3) { t3 = List.GetItemAtIndex(t2@L2<1>, 1); }
toNumber_2 = String.ToNumber(str=code_block_5)
byCoordinates = Point.ByCoordinates(x=toNumber, y=toNumber_2)
code_block_6 = CodeBlock(p=byCoordinates) { p[0..67]; }
code_block_7 = CodeBlock(p=code_block_6) { p[30]; }
code_block_8 = CodeBlock(p=code_block_6) { p[8]; }
byStartPointEndPoint = Line.ByStartPointEndPoint(startPoint=code_block_7, endPoint=code_block_8)
length_2 = Curve.Length(curve=byStartPointEndPoint)
vertices = Autodesk.Dynamo.MeshToolkit.Mesh.Vertices(mesh=importFile)
flatten = List.Flatten(list=vertices)
Y = Point.Y(point=flatten)
minimumItem = List.MinimumItem(list=Y)
byCoordinates_2 = Point.ByCoordinates(y=minimumItem)
origin = Point.Origin()
byStartPointEndPoint_2 = Line.ByStartPointEndPoint(startPoint=byCoordinates_2, endPoint=origin)
length_3 = Curve.Length(curve=byStartPointEndPoint_2)
code_block_9 = CodeBlock(a=length_2, b=length_3) { a/b; }
scale = Autodesk.Dynamo.MeshToolkit.Mesh.Scale(mesh=mirror, scaleFactor=code_block_9)
code_block_10 = CodeBlock { 1; }
byCoordinates_3 = Vector.ByCoordinates(z=code_block_10)
direction = Line.Direction(line=byStartPointEndPoint_2)
direction_2 = Line.Direction(line=byStartPointEndPoint)
angleWithVector = Vector.AngleWithVector(vector=direction, otherVector=direction_2)
rotate = Autodesk.Dynamo.MeshToolkit.Mesh.Rotate(mesh=scale, axis=byCoordinates_3, degrees=angleWithVector)
byTwoPoints = Vector.ByTwoPoints(start=origin, end=code_block_7)
translate = Autodesk.Dynamo.MeshToolkit.Mesh.Translate(mesh=rotate, vector=byTwoPoints)
mesh_triange_count = Input(mesh triange count: var[]..[])
reduce = Autodesk.Dynamo.MeshToolkit.Mesh.Reduce(mesh=translate, triangleCount=mesh_triange_count)
triangles = Autodesk.Dynamo.MeshToolkit.Mesh.Triangles(mesh=reduce)
flatten_2 = List.Flatten(list=triangles)
path_2 = Input(path: var[]..[])
file_from_path_2 = FileObject(path=path_2)
readFromFile = Image.ReadFromFile(file=file_from_path_2)
watch_image = WatchImageCore(image=readFromFile)
dimensions = Image.Dimensions(image=watch_image)
reduce_pixel_by_percentage = CodeBlock { 10; }
code_block_11 = CodeBlock(w=dimensions.width, n=reduce_pixel_by_percentage, h=dimensions.height) { w/n; h/n; }
pixels = Image.Pixels(image=watch_image, xSamples=code_block_11.out0, ySamples=code_block_11.out1)
transpose = List.Transpose(lists=pixels)
flatten_3 = List.Flatten(list=transpose)
XY = Plane.XY()
byWidthLength = Rectangle.ByWidthLength(plane=XY, width=dimensions.width, length=dimensions.height)
code_block_12 = CodeBlock(h=dimensions.width) { h/2; }
code_block_13 = CodeBlock(w=dimensions.height) { w/2; }
translate_2 = Geometry.Translate(geometry=byWidthLength, xTranslation=code_block_12, yTranslation=code_block_13)
byPatch = Surface.ByPatch(closedCurve=translate_2)
code_block_14 = CodeBlock(u=dimensions.width, n=reduce_pixel_by_percentage) { 0..1..#u/n; }
code_block_15 = CodeBlock(v=dimensions.height, n=reduce_pixel_by_percentage) { 0..1..#v/n; }
pointAtParameter = Surface.PointAtParameter(surface=byPatch, u=code_block_14, v=code_block_15, lacing=CrossProduct)
flatten_4 = List.Flatten(list=pointAtParameter)
string_from_object = FromObject(obj=flatten_4)
u = Object.Identity(obj=code_block_14)
restOfItems = List.RestOfItems(list=u)
minimumItem_2 = List.MinimumItem(list=restOfItems)
code_block_16 = CodeBlock { 0.5; }
pointAtParameter_2 = Surface.PointAtParameter(surface=triangles, u=code_block_16, v=code_block_16)
X = Point.X(point=pointAtParameter_2)
Y_2 = Point.Y(point=pointAtParameter_2)
byCoordinates_4 = Point.ByCoordinates(x=X, y=Y_2)
flatten_5 = List.Flatten(list=byCoordinates_4)
UVParameterAtPoint = Surface.UVParameterAtPoint(surface=byPatch, point=flatten_5)
U = UV.U(uV=UVParameterAtPoint)
div = U / minimumItem_2
round = Math.Round(number=div)
mul = minimumItem_2 * round
v = Object.Identity(obj=code_block_15)
restOfItems_2 = List.RestOfItems(list=v)
minimumItem_3 = List.MinimumItem(list=restOfItems_2)
V = UV.V(uV=UVParameterAtPoint)
div_2 = V / minimumItem_3
round_2 = Math.Round(number=div_2)
mul_2 = minimumItem_3 * round_2
pointAtParameter_3 = Surface.PointAtParameter(surface=byPatch, u=mul, v=mul_2)
string_from_object_2 = FromObject(obj=pointAtParameter_3)
indexOf = List.IndexOf(list=string_from_object, element=string_from_object_2)
getItemAtIndex = List.GetItemAtIndex(list=flatten_3, index=indexOf)
byGeometryColor = Modifiers.GeometryColor.ByGeometryColor(geometry=flatten_2, color=getItemAtIndex)
MeshFace = Output(byGeometryColor)
